# Grasshopper definition parametric-sphere.ghx (Grasshopper 1.0.4)

# ---- group: 01 / Shape your input
radius = Slider(12, range=2..30)
longitude = Slider(32, range=6..80)
latitude = Slider(24, range=4..60)

# ---- group: 02 / Build the geometry
sphere = MeshSphere(Base=PlaneXY(0, 0, 0), Radius=radius, UCount=longitude, VCount=latitude)
